# Grasshopper definition Studio_Week1_Ver2_RandomNotApply.ghx (Grasshopper 1.0.7)

dom = ConstructDomain(DomainStart=Slider(4, range=0..10), DomainEnd=Slider(8, range=0..10))
pt = Point([<point referenced from the Rhino model> x6])
lng = ListLength(List=pt)
random = Random(Range=dom, Number=lng, Seed=2)
graft = GraftTree(Tree=pt, IncludeEmptyLists=True, IncludeNullItems=True)
graft_2 = GraftTree(Tree=random, IncludeEmptyLists=True, IncludeNullItems=True)
# ctrl-point out position
# Ctril+Shift-choose multiple
# Ctrl+Alt-show where the position is
# Shit-connect multiple wires
# Hide the Components that don't want to show
lng_2 = ListLength(List=pt)
circle = CircleCNR(Center=graft, Normal=Vector(0, 0, 1), Radius=Slider(1.93, range=0..40))
circle_2 = CircleCNR(Center=graft, Normal=Vector(0, 0, 1), Radius=graft_2)
eval = EvaluateCurve(Curve=reparameterize(circle_2), Parameter=[Slider(0.443, range=0..1), Slider(0.522, range=0..1)])  # -> Point, Tangent, Angle
ln = Line(StartPoint=graft, EndPoint=eval.Point)
trim = TrimWithRegion(Curve=ln, Region=circle)  # -> Inside, Outside
random_2 = Random(Range="360", Number=lng_2, Seed="09403")
crv = Curve(trim.Outside)
panel = Panel(crv)
panel_2 = Panel(random_2)
graft_3 = GraftTree(Tree=random_2, IncludeEmptyLists=True, IncludeNullItems=True)
pshift = ShiftPaths(Data=crv, Offset="-1")
panel_3 = Panel("Confused?")
panel_4 = Panel(pshift)
rotate = Rotate(Geometry=pshift, Angle=degrees(graft_3), Plane=graft)  # -> Geometry, Transform
