# Grasshopper definition Studio_Week1_Ver3.ghx (Grasshopper 1.0.7)

dom = ConstructDomain(DomainStart=Slider(4, range=0..10), DomainEnd=Slider(8, range=0..10))
pt = Point([<point referenced from the Rhino model> x6])
lng = ListLength(List=pt)
random = Random(Range=dom, Number=lng, Seed=2)
graft = GraftTree(Tree=pt, IncludeEmptyLists=True, IncludeNullItems=True)
graft_2 = GraftTree(Tree=random, IncludeEmptyLists=True, IncludeNullItems=True)
circle = CircleCNR(Center=graft, Normal=Vector(0, 0, 1), Radius=graft_2)
multiplication = Multiplication(A=graft_2, B=Slider(0.48, range=0..1))
circle_2 = CircleCNR(Center=graft, Normal=Vector(0, 0, 1), Radius=multiplication)
eval = EvaluateCurve(Curve=circle, Parameter=[Slider(2, range=0..10), Slider(4, range=0..10)])  # -> Point, Tangent, Angle
ln = Line(StartPoint=graft, EndPoint=eval.Point)
trim = TrimWithRegion(Curve=ln, Region=circle_2)  # -> Inside, Outside
lng_2 = ListLength(List=pt)
crv = Curve(trim.Outside)
random_2 = Random(Range="360", Number=lng_2, Seed="1903")
pshift = ShiftPaths(Data=crv, Offset="-1")
graft_3 = GraftTree(Tree=random_2, IncludeEmptyLists=True, IncludeNullItems=True)
rotate = Rotate(Geometry=pshift, Angle=degrees(graft_3), Plane=graft)  # -> Geometry, Transform
