# Grasshopper definition Studio_Week1_Ver5.ghx (Grasshopper 1.0.7)

pt = Point([<point referenced from the Rhino model> x6])
lng = ListLength(List=pt)
dom = ConstructDomain(DomainStart=Slider(5, range=0..10), DomainEnd=Slider(9, range=0..10))
graft = GraftTree(Tree=pt, IncludeEmptyLists=True, IncludeNullItems=True)
random = Random(Range=dom, Number=lng, Seed=2)
graft_2 = GraftTree(Tree=random, IncludeEmptyLists=True, IncludeNullItems=True)
circle = CircleCNR(Center=graft, Normal=Vector(0, 0, 1), Radius=graft_2)
multiplication = Multiplication(A=graft_2, B=Slider(0.317, range=0..1))
circle_2 = CircleCNR(Center=graft, Normal=Vector(0, 0, 1), Radius=multiplication)
eval = EvaluateCurve(Curve=circle, Parameter=[Slider(9, range=0..10), Slider(5, range=0..10)])  # -> Point, Tangent, Angle
lng_2 = ListLength(List=pt)
ln = Line(StartPoint=graft, EndPoint=eval.Point)
random_2 = Random(Range="360", Number=lng_2, Seed="15677")
trim = TrimWithRegions(Curve=ln, Regions=circle_2)  # -> Inside, Outside
crv = Curve(trim.Outside)
graft_3 = GraftTree(Tree=random_2, IncludeEmptyLists=True, IncludeNullItems=True)
pshift = ShiftPaths(Data=crv, Offset="-1")
rotate = Rotate(Geometry=pshift, Angle=degrees(graft_3), Plane=graft)  # -> Geometry, Transform
