# Grasshopper definition Ver1.ghx (Grasshopper 1.0.7)

dom = ConstructDomain(DomainStart=Slider(0, range=0..10), DomainEnd=Slider(10, range=0..10))
range = Range(Domain=dom, Steps=expr("x-1", "10"))
series = Series(Start="2", Step="5", Count="10")
item = ListItem(List=range, Index="0", Wrap=True)  # -> Item, Item1
short = ShortestList(ListA=series, ListB=range, TrimMode=2)  # -> ListA, ListB
subtraction = Subtraction(A=item.Item1, B=item.Item)
pt = ConstructPoint(XCoordinate=short.ListA, YCoordinate=0, ZCoordinate=short.ListB)
Z = UnitZ(Factor=subtraction)
move = Move(Geometry=pt, Motion=Z)  # -> Geometry, Transform
panel = Panel("""0
1""")
weave = Weave(Pattern=panel, Stream0=pt, Stream1=move.Geometry, NullGaps=False)
panel_2 = Panel("""-1
-2""")
points = PointList(Points=weave, Size=Slider(0.84, range=0..10))
cull_i = CullIndex(List=weave, Indices=panel_2, Wrap=True)
order = PointOrder(Points=weave)
pline = PolyLine(Vertices=cull_i, Closed=False)
