# Grasshopper definition Ver1.ghx (Grasshopper 1.0.7)
# plug-ins: RhinoCodePluginGH

number_slider = Slider(6, range=0..10)
crv = Curve(<curve referenced from the Rhino model>)
crv_2 = Curve(<curve referenced from the Rhino model>)
panel = Panel("""0
1""")
divide = DivideCurve(Curve=crv, Count=number_slider, Kinks=False)  # -> Points, Tangents, Parameters; disabled
divide_2 = DivideCurve(Curve=crv_2, Count=number_slider, Kinks=False)  # -> Points, Tangents, Parameters; disabled
S = Script(topFlange=crv, bottomFlange=crv_2)  # -> out, trussWebs; inputs topFlange: Curve, bottomFlange: Curve
# ---------- S: IronPython ----------
import ghpythonlib.components as ghc
#Point A
trussDivision = 10


#Point B
topPoints = ghc.DivideCurve(topFlange, trussDivision, False)
bottomPoints = ghc.DivideCurve (bottomFlange, trussDivision, False)

#Point C
topPoints = ghc.Dispatch(topPoints["points"],[False,True])
bottomPoints = ghc.Dispatch(bottomPoints["points"],[False,True])
#print(topPoints)

#Point D
trussPoints = ghc.Weave ([0,1],topPoints["list_a"],bottomPoints["list_b"])
print(trussPoints)

trussWebs = ghc.PolyLine(trussPoints,False)
# ---------- end S ----------
dispatch = Dispatch(List=divide_2.Points, DispatchPattern=panel)  # -> ListA, ListB; disabled
dispatch_2 = Dispatch(List=divide.Points, DispatchPattern=panel)  # -> ListA, ListB; disabled
pt = Point(dispatch_2.ListA)  # disabled
pt_2 = Point(dispatch.ListB)  # disabled
panel_2 = Panel(S.trussWebs)
weave = Weave(Pattern=panel, Stream0=pt_2, Stream1=pt, NullGaps=False)  # disabled
ln = Line(StartPoint=divide.Points, EndPoint=divide_2.Points)  # disabled
crv_3 = Curve(S.trussWebs)
pline = PolyLine(Vertices=weave, Closed=False)  # disabled
