# Grasshopper definition unnamed.ghx (Grasshopper 1.0.7)
# plug-ins: Kangaroo2 Components

hingepoints = HingePoints()  # -> _1, _2, _3, _4
floor = Floor(Strength=hingepoints._1)
flow = Flow(Geometry=floor, ReverseBase=False, ReverseTarget=False, Stretch=True, Rigid=False)
eval = EvaluateLength(Curve=flow, Normalized=flow)  # -> Point, Tangent, Parameter
